# Grasshopper definition mirror_rotate_copy.gh (Grasshopper 1.0.8)

pt = Point(<point referenced from the Rhino model>)
pt_2 = Point(<point referenced from the Rhino model>)
brep = Brep(<brep referenced from the Rhino model>)
vec2pt = Vector2Pt(PointA=pt_2, PointB=pt, Unitize=False)  # -> Vector, Length
rotate = Slider(0.3055, range=0..1)
rot3d = Rotate3D(Geometry=brep, Angle=Slider(0, range=0..1), Center=pt_2, Axis=vec2pt.Vector)  # -> Geometry, Transform
xy = XYPlane(Origin=Point(0, 0, 0))
pi = Pi(Factor=Slider(2, range=0..10))
Z = UnitZ(Factor=1)
pt_3 = Point(<point referenced from the Rhino model>)
pi_2 = Pi(Factor=rotate)
line = LineSDL(Start=pt_3, Direction=Z, Length=1)
pt_4 = Point(<point referenced from the Rhino model>)
pl_origin = PlaneOrigin(Base=xy, Origin=pt_4)
arrpolar = PolarArray(Geometry=rot3d.Geometry, Plane=pl_origin, Count=Slider(6, range=0..10), Angle=pi)  # -> Geometry, Transform
rotax = RotateAxis(Geometry=arrpolar.Geometry, Angle=pi_2, Axis=line)  # -> Geometry, Transform
Z_2 = UnitZ(Factor=1)
circle = CircleCNR(Center=pt_4, Normal=Vector(0, 0, 1), Radius=Slider(4, range=0..10))
vec = VectorXYZ(XComponent=0, YComponent=0, ZComponent=0)  # -> Vector, Length
multiplication = Multiplication(A=Z_2, B=Slider(372, range=0..1000))
cluster = Cluster(B=rotax.Geometry)
extr = Extrude(Base=circle, Direction=multiplication)
shift = ShiftList(List=cluster, Shift=Slider(1, range=0..10), Wrap=True)
mirror = Mirror(Geometry=rotax.Geometry, Plane=flatten(shift))  # -> Geometry, Transform
mirror_2 = Mirror(Geometry=extr, Plane=cluster)  # -> Geometry, Transform
mirror_3 = Mirror(Geometry=flatten(mirror_2.Geometry), Plane=shift)  # -> Geometry, Transform
mirror_4 = Mirror(Geometry=flatten(mirror_3.Geometry), Plane=shift)  # -> Geometry, Transform

# ==== cluster Cluster
number_slider = Slider(1, range=0..1)
B = ClusterInput()
debrep = DeconstructBrep(Brep=B)  # -> Faces, Edges, Vertices
item = ListItem(List=debrep.Faces, Index=number_slider, Wrap=True)
debrep_2 = DeconstructBrep(Brep=item)  # -> Faces, Edges, Vertices
item_2 = ListItem(List=debrep_2.Vertices, Index=flatten(Slider(2, range=0..10)), Wrap=True)
item_3 = ListItem(List=debrep_2.Vertices, Index=flatten(number_slider), Wrap=True)
item_4 = ListItem(List=debrep_2.Vertices, Index=flatten(Slider(3, range=0..10)), Wrap=True)
pl_3pt = Plane3Pt(PointA=item_3, PointB=item_2, PointC=item_4)
pl = ClusterOutput(pl_3pt)
